# Grasshopper definition load_fabplanes_from_file.ghx (Grasshopper 1.0.8)
# plug-ins: RhinoCodePluginGH

path = FilePath("C:\Users\mangliar\Documents\GitHub\bdm_voxel_builder\temp\fabplanes\2024-09-17_15_51_10_algo_20_fabplanes.txt")
panel = Panel(path)
ipy2 = IronPython2Script(path=path)  # -> out, planes; inputs path: String
# ---------- ipy2: IronPython ----------
"""load fabplanes from file"""

from compas import json_loads
from compas_rhino.conversions import plane_to_rhino
from compas.geometry import Plane

with open(path, "r") as f:
    # data = f.readlines()
    data = f.read()
    lines = data.split('\n')[:-1]
    print(lines[0])
    planes = []
    for line in lines:
        plane = line
        planes.append(plane)
        

# rhino_planes = []
# for plane in planes:
#     rhino_plane = plane_to_rhino(plane)
#     rhino_planes.append(rhino_plane)
# ---------- end ipy2 ----------
ipy2_2 = IronPython2Script(planes=ipy2.planes)  # -> out, rhino_planes; inputs planes: list
# ---------- ipy2_2: IronPython ----------
"""load fabplanes from file"""

from compas import json_loads
from compas_rhino.conversions import plane_to_rhino
from compas.geometry import Plane
# plane = planes[0]
# for plane in planes:
#     print(type(plane))

#     a = json_loads(plane)
compas_planes = [json_loads(data) for data in planes]
rhino_planes = [plane_to_rhino(plane) for plane in compas_planes]

# a = plane_to_rhino(planes[0])
# ---------- end ipy2_2 ----------
panel_2 = Panel(ipy2_2.rhino_planes)
pln = Plane(ipy2_2.rhino_planes)

xy = XYPlane(Origin=Point(0, 0, 0))
neg = Negative(Value=Slider(4, range=0..10))
pl_offset = PlaneOffset(BasePlane=xy, Offset=neg)
cyl = Cylinder(Base=pl_offset, Radius=Slider(5, range=0..10), Length=Slider(5, range=0..10))
mesh = MeshBrep(Settings={GridMaxCount=0, GridMinCount=16, JaggedSeams=False, MaxEdgeLength=0, MinEdgeLength=0.0001, MinTolerance=0, Refine=True, RefineAngle=0, RelativeTolerance=0.65, SimplePlanes=True, Tolerance=0})
cap = CapHoles(Brep=cyl)
jagged = SettingsSpeed()
mesh_2 = MeshBrep(Brep=cap, Settings=jagged)
orient = Orient(Geometry=mesh_2, Source=PlaneXY(0, 0, 0), Target=pln)  # -> Geometry, Transform
